# Grasshopper definition 00_VP_Align_Master.gh (Grasshopper 1.0.8)
# plug-ins: Rhino.Inside for Autodesk Revit, MetaHopper

doubleclick = BooleanToggle(False)
dss_annotation_panel = Panel("Help on WhiteWork")
# Segment
# group modules into larger coherent parts
# User Interface: I/O
dss_log_v5_2 = PythonScript(Help=doubleclick)  # inputs Help: Boolean
# ---------- dss_log_v5_2: Python ----------
"""
Set grasshopper template and provide easy acces to Help file in intranet

"""

"""
Credits:
    20211117
    Created by Vladimir Ondejcik
    White arkitekter AB

Based on:
    WOMBAT version <0.0.1>
    Script by <Brian Ringley>
        def libraries() by <Giulio Piacentino> see <http://www.grasshopper3d.com/forum/topics/gh-filename-is-python>
        def writeToFile() by <Data Analytics Society> see <https://www.youtube.com/watch?v=-TF3mXhnCDw>
    Script version <15 September 2015> 
    Copyright <Creative Commons Sharealike>
"""


#add dsearch default path located on cad.local
import sys
new_path = r"\\sesthfs02\DSEARCH\REPOSITORY\Grasshopper\Xtras\DsearchCode"
if new_path not in sys.path: sys.path.append(new_path)

#import dsearch plugin
import dsearch as ds

import os

print sys.path

#reload module (this has use when working on module)
#reload(ds.DS_Log)
#reload(ds.DS_Links)

#setup template
template=ds.DS_Links.Template
ds.DS_Log.DS_Template(template)

#run help from module 
if Help:
    helpLink=ds.DS_Links.HelpLink
    ds.DS_Log.DS_Help(helpLink)

    #turn toggle back to false
    obj=ghenv.Component.Params.Input[0].Sources[0]
    obj.Value=False
    obj.ExpireSolution(True)
# ---------- end dss_log_v5_2 ----------

dss_projectnumber = Panel("0000")
dss_projectname = Panel("name")

# ----
# Organization of Grasshopper scripts at White:
# Script should be created and annotated always with notion that other person will need to use/edit them.
# Build your script in modules and segments, use color coding and annotation according this template.
# This standard should be applied to all scripts, big or small.
# 
# Read  guide on white work:
# "https://work.white.se/grasshopper-developer-guide/"
# For Advanced users:
# For design scripts running more than a month use "dsInitialize" and "dsScriptLog" functions on Dsearch tab to log changes over time.
dss_annotation_panel_2 = Panel("""Tip of a day:
You can change default colour grups by right clicking
Graphical templates are located on "Dsearch" tab""")
# GRAPHIC
# STANDARD
# In
# data and geometry import from rhino or external platforms
image = ImageSampler(dss_annotation_panel_2, Filter="Colour", Interpolate=False, Umax=1, Umin=0, Vmax=1, Vmin=0, Wrap=0)

active_selection = GraphicalElement()
query_categories = QueryCategories(Type=2, Name="Viewports", IsVisibleUI=True, IsSubcategory=False)

# ---- group: RUN SCRIPT / Predictible viewport
toggle = BooleanToggle(True)
bool = Boolean(toggle)

# ---- group: RUN SCRIPT
button = Button()
onoff = EnableDisableObject(Enabled=toggle)

# ----
view = View(active_selection)
catfltr = CategoryFilter(Categories=query_categories, Inverted=False)
sheet = Sheet(active_selection)
filtelem = FilterElements(Elements=active_selection, Filter=catfltr)
panel = Panel([view, sheet])

query_categories_2 = QueryCategories(Type=1, Name="Lines", IsVisibleUI=True, IsSubcategory=False)
add_subcategory = AddSubCategory(Parent=query_categories_2, Name="Viewframe_Parent_RiR", FailureProcessingMode=1)
category_style = CategoryStyle(Category=add_subcategory, LineWeight_projection="10", LineColor=ColourSwatch(SwatchColor=RGB(0, 0, 255)))  # -> Category, LineWeight_projection, LineWeight_cut, LineColor, LinePattern_projection, Material

cull = CullPattern(List=active_selection, CullPattern=filtelem)
onoff_2 = EnableDisableObject(Enabled=bool)
element_type = ElementType(Element=cull)  # -> Element, Type
element_parameter = ElementParameter(Element=element_type.Type, Parameter="Show Title")  # -> Element, Value
element_parameter_2 = ElementParameter(Element=element_parameter.Element, Parameter="Show Title", Value=Toggle(False))  # -> Element, Value
panel_2 = Panel("""Sections
Elevations""")

# ----
# Control
# General
# Monitor
# Out
# variable parameters and script execution
# (sliders, boolean togggle, text input,...)
# monitor data and geometry preview (used for panels for example)
# output data to rhino or external platforms
# Annotation
# Plugin
# general annotation and notes
# textbased scripting and special plugins
# f.ex: HumanUI, kangaroo,...
# problematic or under repair or construction
dss_annotation_panel_3 = Panel("general development modules")

stream_filter = StreamFilter(Gate=element_parameter_2.Value, Stream0=cull)

# ---- group: Hide studd that disturbs viewport border
# Hide stuff that disturbs viewport border
panel_3 = Panel("""Sections
Elevations""")
panel_4 = Panel("""Detail Items
Lines
Doors""")
panel_5 = Panel("""Dimensions
Grids
Sections
Levels
Text Notes
Spot Elevations""")
query_categories_3 = QueryCategories(Type=2, Name=panel_3, IsVisibleUI=True, IsSubcategory=False)  # -> flatten(Categories)
panel_6 = Panel("Tag")
query_categories_4 = QueryCategories(Discipline=1, Type=2, IsVisibleUI=True, IsSubcategory=False)  # -> flatten(Categories)
view_2 = View(stream_filter)
query_categories_5 = QueryCategories(Type=1, Name=flatten(panel_4), IsVisibleUI=True, IsSubcategory=False)  # -> flatten(Categories)
query_categories_6 = QueryCategories(Type=4, Name="Views", IsVisibleUI=True, IsSubcategory=False)
query_categories_7 = QueryCategories(Type=2, Name=panel_5, IsVisibleUI=True, IsSubcategory=False)  # -> flatten(Categories)
match_text = MatchText(Text=query_categories_4, RegEx="Tags", Case=True)
query_categories_8 = QueryCategories(Type=1, IsVisibleUI=True, IsSubcategory=False)
cull_pattern = CullPattern(List=query_categories_4, CullPattern=match_text)
query_view_elements = QueryViewElements(
    View=simplify(graft(view_2)),
    Categories=flatten([query_categories_5, query_categories_7, query_categories_3, query_categories_6, cull_pattern]))  # -> simplify(Elements)
element_graphic_overrides = ElementGraphicOverrides(View=simplify(graft(view_2)), Element=query_view_elements)  # -> View, simplify(Element), flatten(Hidden), Overrides

# ----
bool_2 = Boolean(Toggle(True))
element_graphic_overrides_2 = ElementGraphicOverrides(View=simplify(graft(view_2)), Element=element_graphic_overrides.Element, Hidden=bool_2)  # -> View, Element, flatten(Hidden), Overrides

# ----
# Back-end
view_3 = View(element_graphic_overrides_2.View)
view_crop_region = ViewCropRegion(View=view_3)  # -> View, CropView, CropRegionVisible, CropRegion
view_crop_region_2 = ViewCropRegion(View=view_crop_region.View, CropView=Toggle(True))  # -> View, CropView, CropRegionVisible, CropRegion
view_4 = View(view_crop_region_2.View)

# ----
# WIP
# Fungerar inte för sektioner/fasader etc.
# Behöver rotationsdel
view_5 = View(view_4)
element_parameter_3 = ElementParameter(Element=view_5, Parameter="Sheet Number")  # -> Element, Value
query_sheets = QuerySheets(Placeholder=False, SheetNumber=element_parameter_3.Value, AppearsInSheetList=True, Assembly=null)
query_viewports = QueryViewports(Sheet=query_sheets)

member_index = MemberIndex(Set=query_viewports, Member=stream_filter)  # -> Index, Count
list_item = ListItem(List=query_viewports, Index=member_index.Index, Wrap=True)
rectangle = Rectangle(list_item)
plane = Plane(rectangle)
offset_curve = OffsetCurve(Curve=rectangle, Distance="-3.1", Plane=plane, Corners=1)
explode = Explode(Curve=offset_curve, Recursive=True)  # -> Segments, Vertices
sheet_2 = Sheet(sheet)
add_detail_line = AddDetailLine(View=sheet_2, Curve=explode.Segments, TrackingMode=1)  # disabled
add_detail_line_2 = AddDetailLine(View=sheet_2, Curve=explode.Segments, TrackingMode=1)
curve_line_style = CurveLineStyle(Element=add_detail_line_2, LineStyle=category_style.Category)  # -> Element, LineStyle
item = ListItem(List=add_detail_line_2, Index=0, Wrap=True)
boolean = Boolean(element_graphic_overrides.Hidden)

element_workset = ElementWorkset(Element=item)  # -> Element, Workset, Status
split = TextSplit(Text=element_workset.Workset, Separators="\"")
item_2 = ListItem(List=split, Index="1", Wrap=True)
split_2 = TextSplit(Text=item_2, Separators=":")
item_3 = ListItem(List=split_2, Index="1", Wrap=True)
trim = TextTrim(Text=item_3, Start=True, End=True)
split_3 = TextSplit(Text=trim, Separators=" ")
item_4 = ListItem(List=split_3, Index=0, Wrap=True)
query_sheets_2 = QuerySheets(Placeholder=False, SheetNumber=item_4, AppearsInSheetList=True, Assembly=null)
lng = ListLength(List=query_sheets_2)
smaller = SmallerThan(FirstNumber=lng, SecondNumber="2")  # -> SmallerThan, OrEqualTo
filter = StreamFilter(Gate=smaller.SmallerThan, Stream1=query_sheets_2)
query_viewports_2 = QueryViewports(Sheet=filter)
mindex = MemberIndex(Set=query_viewports_2, Member=stream_filter)  # -> Index, Count
toggle_2 = BooleanToggle(False)
item_5 = ListItem(List=query_viewports_2, Index=mindex.Index, Wrap=True)
view_6 = View(item_5)
element_graphic_overrides_3 = ElementGraphicOverrides(View=simplify(graft(view_6)), Element=element_graphic_overrides_2.Element, Hidden=boolean)  # -> View, Element, flatten(Hidden), Overrides
view_crop_region_3 = ViewCropRegion(View=element_graphic_overrides_3.View, CropView=view_crop_region.CropView)  # -> View, CropView, CropRegionVisible, CropRegion

view_7 = View(view_crop_region_3.View)
element_parameter_4 = ElementParameter(Element=view_7, Parameter="Sheet Number")  # -> Element, Value
query_sheets_3 = QuerySheets(Placeholder=False, SheetNumber=element_parameter_4.Value, AppearsInSheetList=True, Assembly=null)
query_viewports_3 = QueryViewports(Sheet=query_sheets_3)

boolean_2 = Boolean(element_parameter.Value)

# ---- group: Reset view title
member_index_2 = MemberIndex(Set=query_viewports_3, Member=stream_filter)  # -> Index, Count
list_item_2 = ListItem(List=query_viewports_3, Index=member_index_2.Index, Wrap=True)
element_type_2 = ElementType(Element=list_item_2)  # -> Element, Type
element_parameter_5 = ElementParameter(Element=element_type_2.Type, Parameter="Show Title", Value=boolean_2)  # -> Element, Value
