# Grasshopper definition 01_VP_Align_Set.gh (Grasshopper 1.0.8)
# plug-ins: Pufferfish, Rhino.Inside for Autodesk Revit, MetaHopper

doubleclick = BooleanToggle(False)
dss_annotation_panel = Panel("Help on WhiteWork")
# Segment
# group modules into larger coherent parts
# User Interface: I/O
dss_log_v5_2 = PythonScript(Help=doubleclick)  # inputs Help: Boolean
# ---------- dss_log_v5_2: Python ----------
"""
Set grasshopper template and provide easy acces to Help file in intranet

"""

"""
Credits:
    20211117
    Created by Vladimir Ondejcik
    White arkitekter AB

Based on:
    WOMBAT version <0.0.1>
    Script by <Brian Ringley>
        def libraries() by <Giulio Piacentino> see <http://www.grasshopper3d.com/forum/topics/gh-filename-is-python>
        def writeToFile() by <Data Analytics Society> see <https://www.youtube.com/watch?v=-TF3mXhnCDw>
    Script version <15 September 2015> 
    Copyright <Creative Commons Sharealike>
"""


#add dsearch default path located on cad.local
import sys
new_path = r"\\sesthfs02\DSEARCH\REPOSITORY\Grasshopper\Xtras\DsearchCode"
if new_path not in sys.path: sys.path.append(new_path)

#import dsearch plugin
import dsearch as ds

import os

print sys.path

#reload module (this has use when working on module)
#reload(ds.DS_Log)
#reload(ds.DS_Links)

#setup template
template=ds.DS_Links.Template
ds.DS_Log.DS_Template(template)

#run help from module 
if Help:
    helpLink=ds.DS_Links.HelpLink
    ds.DS_Log.DS_Help(helpLink)

    #turn toggle back to false
    obj=ghenv.Component.Params.Input[0].Sources[0]
    obj.Value=False
    obj.ExpireSolution(True)
# ---------- end dss_log_v5_2 ----------

dss_projectnumber = Panel("0000")
dss_projectname = Panel("name")

# ----
# Organization of Grasshopper scripts at White:
# Script should be created and annotated always with notion that other person will need to use/edit them.
# Build your script in modules and segments, use color coding and annotation according this template.
# This standard should be applied to all scripts, big or small.
# 
# Read  guide on white work:
# "https://work.white.se/grasshopper-developer-guide/"
# For Advanced users:
# For design scripts running more than a month use "dsInitialize" and "dsScriptLog" functions on Dsearch tab to log changes over time.
dss_annotation_panel_2 = Panel("""Tip of a day:
You can change default colour grups by right clicking
Graphical templates are located on "Dsearch" tab""")
# GRAPHIC
# STANDARD
# In
# data and geometry import from rhino or external platforms
image = ImageSampler(dss_annotation_panel_2, Filter="Colour", Interpolate=False, Umax=1, Umin=0, Vmax=1, Vmin=0, Wrap=0)

active_selection = GraphicalElement()
categories = QueryCategories(Type=2, Name="Viewports", IsVisibleUI=True, IsSubcategory=False)

# ---- group: Find frame of parent
categories_2 = QueryCategories(Type=1, Name="Lines", IsVisibleUI=True, IsSubcategory=False)
catfltr = CategoryFilter(Categories=categories_2, Inverted=False)
elements = QueryElements(Filter=catfltr, Limit=10)  # -> Elements, Count
item = ListItem(List=elements.Elements, Index=0, Wrap=True)
inspect = InspectElement(Element=item)  # -> DimensionsLength, GraphicsLineStyle, GraphicsDetailLine, IdentityDataEditedBy, IdentityDataWorkset
parameter = Parameter(inspect.GraphicsLineStyle)
line_styles = QueryLineStyles(Name="Viewframe_Parent_RiR")
equals = EqualsRule(Parameter=parameter, Value=line_styles)
parafltr = ParameterFilter(Rules=equals, Inverted=False)
elements_2 = QueryElements(Filter=parafltr, Limit=100)  # -> Elements, Count
join = JoinCurves(Curves=elements_2.Elements, Preserve=False)

# ---- group: RUN SCRIPT
onoff = EnableDisableObject(Enabled=Button())

# ---- group: RUN SCRIPT / Predictible viewport
bool = Boolean(Toggle(True))

# ----
view = View(active_selection)
catfltr_2 = CategoryFilter(Categories=categories, Inverted=False)
sheet = Sheet(active_selection)
filtelem = FilterElements(Elements=active_selection, Filter=catfltr_2)
panel = Panel([view, sheet])
cull = CullPattern(List=active_selection, CullPattern=filtelem)
onoff_2 = EnableDisableObject(Enabled=bool, AllObjects_Object=eg_overrides)
panel_2 = Panel("""Sections
Elevations""")

# ----
# Control
# General
# Monitor
# Out
# variable parameters and script execution
# (sliders, boolean togggle, text input,...)
# monitor data and geometry preview (used for panels for example)
# output data to rhino or external platforms
# Annotation
# Plugin
# general annotation and notes
# textbased scripting and special plugins
# f.ex: HumanUI, kangaroo,...
# problematic or under repair or construction
dss_annotation_panel_3 = Panel("general development modules")

categories_3 = QueryCategories(Type=2, Name=panel_2, IsVisibleUI=True, IsSubcategory=False)  # -> flatten(Categories)
panel_3 = Panel("""Detail Items
Lines
Text Notes""")
panel_4 = Panel("""Dimensions
Grids
Sections
Levels""")

# ---- group: Hide studd that disturbs viewport border
# Hide stuff that disturbs viewport border
panel_5 = Panel("Views")
view_2 = View(cull)
categories_4 = QueryCategories(Type=4, Name=panel_5, IsVisibleUI=True, IsSubcategory=False)
categories_5 = QueryCategories(Type=2, Name=panel_4, IsVisibleUI=True, IsSubcategory=False)  # -> flatten(Categories)
categories_6 = QueryCategories(Type=1, Name=panel_3, IsVisibleUI=True, IsSubcategory=False)
v_elements = QueryViewElements(View=simplify(graft(view_2)), Categories=flatten([categories_6, categories_5, categories_3, categories_4]))  # -> simplify(Elements)
# Back-end
eg_overrides = ElementGraphicOverrides(View=simplify(graft(view_2)), Element=v_elements, Hidden=bool)  # -> View, Element, flatten(Hidden), Overrides

# ----
eg_overrides_2 = ElementGraphicOverrides(View=simplify(graft(view_2)), Element=v_elements)  # -> View, Element, flatten(Hidden), Overrides
view_3 = View(eg_overrides.View)
cropregn = ViewCropRegion(View=view_3)  # -> View, CropView, CropRegionVisible, CropRegion
cropregn_2 = ViewCropRegion(View=cropregn.View, CropView=Toggle(True))  # -> View, CropView, CropRegionVisible, CropRegion
# WIP
# Fungerar inte för sektioner/fasader etc.
# Behöver rotationsdel
view_4 = View(cropregn_2.View)
sheet_2 = Sheet(view_4)
vports = QueryViewports(Sheet=sheet_2)
mindex = MemberIndex(Set=vports, Member=cull)  # -> Index, Count
item_2 = ListItem(List=vports, Index=mindex.Index, Wrap=True)
view_5 = View(item_2)
param = ElementParameter(Element=view_4, Parameter="View Name")  # -> Element, Value

# ---- group: Same center as view?
data = Data(item_2)
rec = Rectangle(data)
neg = Negative(Value=Slider(50, range=0..100))
offcrv = OffsetCurve(Curve=rec, Plane=PlaneXY(0, 0, 0), Distance=neg, BothSides=0, Kinks=0, CapType=1)
pcen = PolygonCenter(Polyline=offcrv)  # -> CenterV, CenterE, CenterA
pt = Point(pcen.CenterV)

# ----
panel_6 = Panel("Revision Clouds")
views = QueryViews(ViewName=param.Value, IsDependent=False, IsTemplate=False)
views_2 = QueryViews(ViewName=param.Value, IsDependent=True, IsTemplate=False)
rec_2 = Rectangle([views, views_2])
pln = Plane([views, views_2])

# ---- group: Move from center of view to center of viewport
rec_3 = Rectangle(rec_2)
pt_2 = Point(pt)
pcen_2 = PolygonCenter(Polyline=rec_3)  # -> CenterV, CenterE, CenterA
vec2pt = Vector2Pt(PointA=pcen_2.CenterV, PointB=pt_2, Unitize=False)  # -> Vector, Length
vec = Vector(vec2pt.Vector)

# ----
deplane = DeconstructPlane(Plane=pln)  # -> Origin, XAxis, YAxis, ZAxis
pl = ConstructPlane(Origin=pcen_2.CenterV, XAxis=Vector(1, 0, 0), YAxis=Vector(0, 1, 0))
pl_2 = ConstructPlane(Origin=pcen_2.CenterV, XAxis=deplane.XAxis, YAxis=deplane.YAxis)
deplane_2 = DeconstructPlane(Plane=pl)  # -> Origin, XAxis, YAxis, ZAxis
orient = Orient(Geometry=rec_2, Source=pl_2, Target=pl)  # -> Geometry, Transform
orient_2 = Orient(Geometry=rec_3, Source=pl_2, Target=pl)  # -> Geometry, Transform

move = Move(Geometry=orient_2.Geometry, Motion=vec)  # -> Geometry, Transform
pcen_3 = PolygonCenter(Polyline=join)  # -> CenterV, CenterE, CenterA
pcen_4 = PolygonCenter(Polyline=move.Geometry)  # -> CenterV, CenterE, CenterA

# ---- group: Place on sheet
view_6 = View(view_4)
param_2 = ElementParameter(Element=view_6, Parameter="View Scale")  # -> Element, Value
pt_3 = Point(pcen_4.CenterV)
division = Division(A="1", B=param_2.Value)

# ----
scale = Scale(Geometry=move.Geometry, Center=pt_3, Factor=division)  # -> Geometry, Transform
pcen_5 = PolygonCenter(Polyline=scale.Geometry)  # -> CenterV, CenterE, CenterA
vec2pt_2 = Vector2Pt(PointA=pcen_5.CenterV, PointB=pcen_3.CenterV, Unitize=False)  # -> Vector, Length
location = ElementLocation(Element=active_selection)  # -> Element, Location, Hand, Facing, WorkPlane
vdis = VectorDisplay(Anchor=pcen_5.CenterV, Vector=vec2pt_2.Vector)
move_2 = Move(Geometry=location.Location, Motion=vec2pt_2.Vector)  # -> Geometry, Transform
location_2 = ElementLocation(Element=location.Element, Location=move_2.Geometry)  # -> Element, Location, Hand, Facing, WorkPlane
item_3 = ListItem(List=scale.Geometry, Index=0, Wrap=True)
view_7 = View(location_2.Element)

workset = ElementWorkset(Element=item_3)  # -> Element, Workset, Status
split = TextSplit(Text=workset.Workset, Separators="\"")
item_4 = ListItem(List=split, Index="1", Wrap=True)
split_2 = TextSplit(Text=item_4, Separators=":")
item_5 = ListItem(List=split_2, Index="1", Wrap=True)
trim = TextTrim(Text=item_5, Start=True, End=True)
split_3 = TextSplit(Text=trim, Separators=" ")
item_6 = ListItem(List=split_3, Index=0, Wrap=True)
sheets = QuerySheets(Placeholder=False, SheetNumber=item_6, AppearsInSheetList=True, Assembly=null)
lng = ListLength(List=sheets)
smaller = SmallerThan(FirstNumber=lng, SecondNumber="2")  # -> SmallerThan, OrEqualTo
filter = StreamFilter(Gate=smaller.SmallerThan, Stream1=sheets)
vports_2 = QueryViewports(Sheet=filter)
mindex_2 = MemberIndex(Set=vports_2, Member=cull)  # -> Index, Count
item_7 = ListItem(List=vports_2, Index=mindex_2.Index, Wrap=True)
view_8 = View(item_7)
eg_overrides_3 = ElementGraphicOverrides(View=simplify(graft(view_7)), Element=v_elements, Hidden=Toggle(False))  # -> View, Element, flatten(Hidden), Overrides
cropregn_3 = ViewCropRegion(View=eg_overrides_3.View, CropView=cropregn.CropView)  # -> View, CropView, CropRegionVisible, CropRegion
