# Grasshopper definition 40_RCloudUp.gh (Grasshopper 1.0.8)
# plug-ins: Pufferfish, Rhino.Inside for Autodesk Revit, MetaHopper

doubleclick = BooleanToggle(False)
dss_annotation_panel = Panel("Help on WhiteWork")
# Segment
# group modules into larger coherent parts
# User Interface: I/O
dss_log_v5_2 = PythonScript(Help=doubleclick)  # inputs Help: Boolean
# ---------- dss_log_v5_2: Python ----------
"""
Set grasshopper template and provide easy acces to Help file in intranet

"""

"""
Credits:
    20211117
    Created by Vladimir Ondejcik
    White arkitekter AB

Based on:
    WOMBAT version <0.0.1>
    Script by <Brian Ringley>
        def libraries() by <Giulio Piacentino> see <http://www.grasshopper3d.com/forum/topics/gh-filename-is-python>
        def writeToFile() by <Data Analytics Society> see <https://www.youtube.com/watch?v=-TF3mXhnCDw>
    Script version <15 September 2015> 
    Copyright <Creative Commons Sharealike>
"""


#add dsearch default path located on cad.local
import sys
new_path = r"\\sesthfs02\DSEARCH\REPOSITORY\Grasshopper\Xtras\DsearchCode"
if new_path not in sys.path: sys.path.append(new_path)

#import dsearch plugin
import dsearch as ds

import os

print sys.path

#reload module (this has use when working on module)
#reload(ds.DS_Log)
#reload(ds.DS_Links)

#setup template
template=ds.DS_Links.Template
ds.DS_Log.DS_Template(template)

#run help from module 
if Help:
    helpLink=ds.DS_Links.HelpLink
    ds.DS_Log.DS_Help(helpLink)

    #turn toggle back to false
    obj=ghenv.Component.Params.Input[0].Sources[0]
    obj.Value=False
    obj.ExpireSolution(True)
# ---------- end dss_log_v5_2 ----------

dss_projectnumber = Panel("0000")
dss_projectname = Panel("name")

# ----
# Organization of Grasshopper scripts at White:
# Script should be created and annotated always with notion that other person will need to use/edit them.
# Build your script in modules and segments, use color coding and annotation according this template.
# This standard should be applied to all scripts, big or small.
# 
# Read  guide on white work:
# "https://work.white.se/grasshopper-developer-guide/"
# For Advanced users:
# For design scripts running more than a month use "dsInitialize" and "dsScriptLog" functions on Dsearch tab to log changes over time.
dss_annotation_panel_2 = Panel("""Tip of a day:
You can change default colour grups by right clicking
Graphical templates are located on "Dsearch" tab""")
# GRAPHIC
# STANDARD
# In
# data and geometry import from rhino or external platforms
image = ImageSampler(dss_annotation_panel_2, Filter="Colour", Interpolate=False, Umax=1, Umin=0, Vmax=1, Vmin=0, Wrap=0)

active_selection = GraphicalElement()
categories = QueryCategories(Type=2, Name="Viewports", IsVisibleUI=True, IsSubcategory=False)

# ---- group: RUN SCRIPT
onoff = EnableDisableObject(Enabled=Button(), AllObjects_Object=r_cloud)

# ---- group: DELETE REVISION CLOUDS ON VIEW
onoff_2 = EnableDisableObject(Enabled=Button(), AllObjects_Object=[v_elements, panel, categories_2, delete])

# ---- group: RUN SCRIPT / Predictible viewport
bool = Boolean(Toggle(True))

# ----
view = View(active_selection)
catfltr = CategoryFilter(Categories=categories, Inverted=False)
sheet = Sheet(active_selection)

# ---- group: Delete Revison Cloud on sheet
panel = Panel("Revision Clouds")  # disabled
categories_2 = QueryCategories(Type=2, Name=panel, IsVisibleUI=True, IsSubcategory=False)  # disabled
v_elements = QueryViewElements(View=view, Categories=categories_2)  # disabled
delete = DeleteElement(Elements=v_elements)  # disabled

# ----
filtelem = FilterElements(Elements=active_selection, Filter=catfltr)
panel_2 = Panel([view, sheet])
cull = CullPattern(List=active_selection, CullPattern=filtelem)
onoff_3 = EnableDisableObject(Enabled=bool, AllObjects_Object=eg_overrides)
panel_3 = Panel("""Sections
Elevations""")

# ----
# Control
# General
# Monitor
# Out
# variable parameters and script execution
# (sliders, boolean togggle, text input,...)
# monitor data and geometry preview (used for panels for example)
# output data to rhino or external platforms
# Annotation
# Plugin
# general annotation and notes
# textbased scripting and special plugins
# f.ex: HumanUI, kangaroo,...
# problematic or under repair or construction
dss_annotation_panel_3 = Panel("general development modules")

categories_3 = QueryCategories(Type=2, Name=panel_3, IsVisibleUI=True, IsSubcategory=False)  # -> flatten(Categories)
panel_4 = Panel("""Detail Items
Lines
Text Notes""")
panel_5 = Panel("""Dimensions
Grids
Sections
Levels""")
categories_4 = QueryCategories(Type=4, Name="Views", IsVisibleUI=True, IsSubcategory=False)

# ---- group: Hide studd that disturbs viewport border
# Hide stuff that disturbs viewport border
view_2 = View(cull)
categories_5 = QueryCategories(Type=2, Name=panel_5, IsVisibleUI=True, IsSubcategory=False)  # -> flatten(Categories)
categories_6 = QueryCategories(Type=1, Name=panel_4, IsVisibleUI=True, IsSubcategory=False)
v_elements_2 = QueryViewElements(View=simplify(graft(view_2)), Categories=flatten([categories_6, categories_5, categories_3, categories_4]))  # -> simplify(Elements)
# Back-end
eg_overrides = ElementGraphicOverrides(View=simplify(graft(view_2)), Element=v_elements_2, Hidden=bool)  # -> View, Element, flatten(Hidden), Overrides

# ----
eg_overrides_2 = ElementGraphicOverrides(View=simplify(graft(view_2)), Element=v_elements_2)  # -> View, Element, flatten(Hidden), Overrides
view_3 = View(eg_overrides.View)
cropregn = ViewCropRegion(View=view_3)  # -> View, CropView, CropRegionVisible, CropRegion
cropregn_2 = ViewCropRegion(View=cropregn.View, CropView=Toggle(True))  # -> View, CropView, CropRegionVisible, CropRegion
view_4 = View(cropregn_2.View)
sheet_2 = Sheet(view_4)
vports = QueryViewports(Sheet=sheet_2)
mindex = MemberIndex(Set=vports, Member=cull)  # -> Index, Count
item = ListItem(List=vports, Index=mindex.Index, Wrap=True)
view_5 = View(item)
param = ElementParameter(Element=view_4, Parameter="View Name")  # -> Element, Value
views = QueryViews(ViewName=param.Value, IsDependent=False, IsTemplate=False)
pln = Plane(view_4)
rec = Rectangle(views)
pln_2 = Plane(views)

# ---- group: Same center as view?
data = Data(item)
rec_2 = Rectangle(data)
neg = Negative(Value=Slider(50, range=0..100))
offcrv = OffsetCurve(Curve=rec_2, Plane=PlaneXY(0, 0, 0), Distance=neg, BothSides=0, Kinks=0, CapType=1)
pcen = PolygonCenter(Polyline=offcrv)  # -> CenterV, CenterE, CenterA
pt = Point(pcen.CenterV)

# ----
categories_7 = QueryCategories(Type=2, Name="Revision Clouds", IsVisibleUI=True, IsSubcategory=False)

panel_6 = Panel("""Revision
Comments""")
v_elements_3 = QueryViewElements(View=view_4, Categories=categories_7)
item_2 = ListItem(List=v_elements_3, Index=0, Wrap=True)
parameters = QueryElementParameters(Element=item_2, Name=panel_6, ReadOnly=False)  # -> flatten(Parameters)
param_2 = ElementParameter(Element=simplify(graft(v_elements_3)), Parameter=parameters)  # -> Element, simplify(Value)

geometry = ElementGeometry(Elements=v_elements_3)  # -> simplify(Geometry)

join = JoinCurves(Curves=geometry, Preserve=False)  # -> simplify(Curves)
# WIP
# Fungerar inte för sektioner/fasader etc.
# Behöver rotationsdel
explode = Explode(Curve=join, Recursive=True)  # -> Segments, Vertices
neg_2 = Negative(Value="180")

midpt = CurveMiddle(Curve=explode.Segments)
pline = PolyLine(Vertices=midpt, Closed=True)
offcrv_2 = OffsetCurve(Curve=pline, Plane=pln, Distance=neg_2, BothSides=0, Kinks=0, CapType=1)
brec = BoundingRectangle(Geometry=offcrv_2, Plane=pln, Axis=0, Slide=0, Union=True)  # -> Bounding, DimensionX, DimensionY
rec_3 = Rectangle(simplify(brec.Bounding))

deplane = DeconstructPlane(Plane=pln_2)  # -> Origin, XAxis, YAxis, ZAxis

# ---- group: Move from center of view to center of viewport
rec_4 = Rectangle(rec)
pt_2 = Point(pt)
pcen_2 = PolygonCenter(Polyline=rec_4)  # -> CenterV, CenterE, CenterA
vec2pt = Vector2Pt(PointA=pcen_2.CenterV, PointB=pt_2, Unitize=False)  # -> Vector, Length
vec = Vector(vec2pt.Vector)

# ----
pl = ConstructPlane(Origin=pcen_2.CenterV, XAxis=Vector(1, 0, 0), YAxis=Vector(0, 1, 0))
pl_2 = ConstructPlane(Origin=pcen_2.CenterV, XAxis=deplane.XAxis, YAxis=deplane.YAxis)
deplane_2 = DeconstructPlane(Plane=pl)  # -> Origin, XAxis, YAxis, ZAxis
orient = Orient(Geometry=rec_3, Source=pl_2, Target=pl)  # -> Geometry, Transform
orient_2 = Orient(Geometry=rec_4, Source=pl_2, Target=pl)  # -> Geometry, Transform

vdis = VectorDisplay(Anchor=pcen_2.CenterV, Vector=vec)

# ---- group: Move from center of view to center of viewport (continued)
move = Move(Geometry=orient.Geometry, Motion=vec)  # -> simplify(Geometry), Transform

# ----
match = MatchTree(Tree=move.Geometry, Guide=rec_3)
brec_2 = BoundingRectangle(Geometry=simplify(graft(match)), Plane=PlaneXY(0, 0, 0), Axis=0, Slide=0, Union=True)  # -> simplify(Bounding), DimensionX, DimensionY
move_2 = Move(Geometry=orient_2.Geometry, Motion=vec)  # -> Geometry, Transform
pcen_3 = PolygonCenter(Polyline=move_2.Geometry)  # -> CenterV, CenterE, CenterA
cluster = Cluster(data=brec_2.Bounding)

# ---- group: Place on sheet
view_6 = View(view_4)
revisions = QueryRevisions()
param_3 = ElementParameter(Element=view_6, Parameter="View Scale")  # -> Element, Value
value_picker = ValuePicker(revisions)
pt_3 = Point(pcen_3.CenterV)
division = Division(A="1", B=param_3.Value)
scale = Scale(Geometry=cluster, Center=pt_3, Factor=division)  # -> simplify(Geometry), Transform
sheet_3 = Sheet(sheet)

# ----
scale_2 = Scale(Geometry=move_2.Geometry, Center=pt_3, Factor=division)  # -> Geometry, Transform
pcen_4 = PolygonCenter(Polyline=scale_2.Geometry)  # -> CenterV, CenterE, CenterA
crv = Curve(scale.Geometry)

# ---- group: Place on sheet (continued)
r_cloud = AddRevisionCloud(View=sheet_3, Boundary=crv, Revision=value_picker)  # -> simplify(graft(Cloud))

# ----
workset = ElementWorkset(Element=r_cloud)  # -> Element, Workset, Status
param_4 = ElementParameter(Element=r_cloud, Parameter=parameters, Value=param_2.Value)  # -> Element, simplify(Value)
inspect = InspectElement(Element=r_cloud)  # -> IdentityDataComments, IdentityDataMark, IdentityDataEditedBy, IdentityDataWorkset, IdentityDataRevision, IdentityDataRevisionDate, IdentityDataIssuedBy, IdentityDataIssuedTo, IdentityDataRevisionNumber
split = TextSplit(Text=workset.Workset, Separators="\"")
item_3 = ListItem(List=split, Index="1", Wrap=True)
split_2 = TextSplit(Text=item_3, Separators=":")
item_4 = ListItem(List=split_2, Index="1", Wrap=True)
trim = TextTrim(Text=item_4, Start=True, End=True)
split_3 = TextSplit(Text=trim, Separators=" ")
item_5 = ListItem(List=split_3, Index=0, Wrap=True)
sheets = QuerySheets(Placeholder=False, SheetNumber=item_5, AppearsInSheetList=True, Assembly=null)
lng = ListLength(List=sheets)
smaller = SmallerThan(FirstNumber=lng, SecondNumber="2")  # -> SmallerThan, OrEqualTo
filter = StreamFilter(Gate=smaller.SmallerThan, Stream1=sheets)
vports_2 = QueryViewports(Sheet=filter)
mindex_2 = MemberIndex(Set=vports_2, Member=cull)  # -> Index, Count
item_6 = ListItem(List=vports_2, Index=mindex_2.Index, Wrap=True)
view_7 = View(item_6)
eg_overrides_3 = ElementGraphicOverrides(View=simplify(graft(view_7)), Element=v_elements_2, Hidden=Toggle(False))  # -> View, Element, flatten(Hidden), Overrides
cropregn_3 = ViewCropRegion(View=eg_overrides_3.View, CropView=cropregn.CropView)  # -> View, CropView, CropRegionVisible, CropRegion

# ==== cluster Cluster
data = ClusterInput()

# ---- group: Tree to main index
data_2 = Data(data)
clean = CleanTree(RemoveNulls=True, RemoveInvalid=True, RemoveEmpty=True, Tree=data_2)
data_3 = Data(clean)

# ---- group: Tree to main index / Gets main index from path
tstat = TreeStatistics(Tree=clean)  # -> Paths, Length, Count
split = TextSplit(Text=tstat.Paths, Separators=";")  # -> simplify(Result)
item = ListItem(List=split, Index=0, Wrap=True)
concat = Concatenate(FragmentA=item, FragmentB="}")
rep = ReplaceText(Text=concat, Find="}}", Replace="}", RecursiveReplace=False)
dup = DuplicateData(Data=rep, Number=simplify(graft(tstat.Length)), Order=True)  # -> flatten(Data)

# ---- group: Tree to main index (continued)
tree = CreateTree(Data=data_3, Path=dup)
data_4 = Data(tree)

# ----
data_5 = ClusterOutput(data_4)
